# Grasshopper definition Async Test-Anemone.gh (Grasshopper 1.0.7)
# plug-ins: Anemone

loop_start = LoopStart(Repeat=Slider(3, range=0..10), Data=Slider(1, range=0..1))  # -> port, Counter, Data
addition = Addition(A=loop_start.Counter, B=1)
multiplication = Multiplication(A=addition, B=loop_start.Data)
running = Running(port=loop_start.port, Exit=False, Data=multiplication, TimeOutVal=0, pausedState=False, state="Constant & Record")
